# Grasshopper definition vet_hops.gh (Grasshopper 1.0.8)
# plug-ins: Kangaroo2 Components

width = GetInteger(Slider(5, range=2..5), AtLeast=1, AtMost=1, Maximum=2147483647, Minimum=-2147483648, TreeAccess=False)
length = GetInteger(Slider(6, range=3..7), AtLeast=1, AtMost=1, Maximum=2147483647, Minimum=-2147483648, TreeAccess=False)
number_slider = Slider(35, range=25..50)
rectangle = Rectangle(Plane=PlaneXY(0, 0, 0), XSize=width, YSize=length, Radius=0)  # -> Rectangle, Length
mplane = MeshPlane(Boundary=rectangle.Rectangle, WidthCount=number_slider, HeightCount=number_slider)  # -> Mesh, Area
mesh = Mesh(mplane.Mesh)
nv = NakedVertices(Mesh=mesh)  # -> ClothedIndex, NakedIndex, ClothedPts, NakedPts
pt = Point(nv.NakedPts)
demesh = DeconstructMesh(Mesh=mesh)  # -> Vertices, Faces, Colours, Normals
dispatch = Dispatch(List=pt, DispatchPattern=[True, False])  # -> ListA, ListB
toggle = BooleanToggle(True)
Z = UnitZ(Factor=1)
pt_2 = Point(dispatch.ListA)
anchorxyz = AnchorXYZ(Point=dispatch.ListB, X=toggle, Y=toggle, Z=False, Strength=1000)
anchor = Anchor(Point=pt_2, Strength=10000)
show = Show(G=mesh)
edgelengths = EdgeLengths(Mesh=mesh, LengthFactor=Slider(1, range=0..1), Strength=Slider(100, range=0..100))
load = Load(Point=demesh.Vertices, ForceVector=Z, Weighting=1)
merge = Merge(Data1=flatten(show), Data2=flatten(edgelengths), Data3=flatten(load), Data4=flatten(anchor), Data5=anchorxyz)
zombiesolver = ZombieSolver(GoalObjects=merge, Threshold=1e-10, Tolerance=0.0001, MaxIterations=50000)  # -> I, V, O
item = ListItem(List=zombiesolver.O, Index=0, Wrap=True)
mesh_2 = Mesh(item)
context_bake = ContextBake(Content=mesh_2)
